# Grasshopper definition Day02-END.ghx (Grasshopper 1.0.7)
# Copyright: Alan Rynne

series = Series(Start=0, Step="0.1", Count=Slider(21, range=0..100))
pt = ConstructPoint(XCoordinate=graft(series), YCoordinate=series, ZCoordinate=0)  # -> simplify(Point)

# ---- group: Comparing numbers and formatting
python = GhPythonScript(number=Slider(4, range=0..10), compare=Slider(4, range=0..10))  # -> out
# ---------- python: Python ----------
import Rhino.Geometry as rg
# BOOLEAN VALUES, COMPARISONS AND CONDITIONALS

# Boolean values can be 'True' (notice capitalization)
boolean = True
print(boolean)

# or 'False'
boolean = False
print(boolean)

# You can make comparisons between values using '==' (two equal signs)
check = (boolean == False)
# A comparison will always return a boolean value.
print(check)

# You can think of comparisons as YES or NO questions:
# - Is this value equals to 'True'?
# - Is this value bigger than 5?
# - Is this point's Z coordinate bigger than 7.0?

# Other comparisons are available

# 'number' and 'compare' are inputs coming from GH
print('\t--> Comparing number {} with {} <--'.format(number,compare))

# Equality check
checkEqual = number == compare
print('{}\t--> Number {} equals to {}'.format(checkEqual,number, compare))

# Inequality check
checkEqual = number != compare
print('{}\t--> Number {} NOT equals to {}'.format(checkEqual,number, compare))

# Bigger than
checkBigger = number > compare
print('{}\t--> Number {} is bigger than {}'.format(checkBigger, number, compare))

# Bigger or equals than
checkBiggerEquals = number >= compare
print('{}\t--> Number {} is bigger or equals than {}'.format(checkBiggerEquals, number, compare))

# Smaller than
checkSmaller = number < compare
print('{}\t--> Number {} is smaller than {}'.format(checkSmaller, number, compare))

# Smaller or equals than
checkSmallerEquals = number <= compare
print('{}\t--> Number {} is smaller or equals than {}'.format(checkSmallerEquals, number, compare))


# You can also compare simple geometry entities (points, vectors...)
ptA = rg.Point3d(0,0,number)
ptB = rg.Point3d(0,0,compare)
checkPt = ptA == ptB
print('--> Comparing point {} to point {} <--'.format(ptA,ptB))
print('{} --> PointA is equal to PointB'.format(checkPt))

# Once you have a boolean value, you can 'negate' it by using the 'not()' function.
print(checkPt)
print(not(checkPt))
# ---------- end python ----------
panel = Panel(python)

# ---- group: Prev day exercise
range = Range(Domain=Domain(0, 1), Steps=Slider(10, range=0..10))
pt_2 = ConstructPoint(XCoordinate=graft(range), YCoordinate=range, ZCoordinate=0)
pt_3 = Point(Point(0.9634185682, 0.4892154751, 0.05846322429))
python_2 = GhPythonScript(point=pt_2, attractor=pt_3)  # -> out, circle, line, extrude; inputs point: Point3d, attractor: Point3d
# ---------- python_2: Python ----------
import Rhino.Geometry as rg

# We are going to create a simple 'attractor' exercise. 
# Given a point from a grid and an attractor point:

# 1. Get the distance between the point and the attractor
distance = point.DistanceTo(attractor)

# 2. Distance is usually too big to use as a radius, so divide by 10 (or whatever)
radius = distance / 10

# 3. Create a circle using point and ratio
circle = rg.Circle(point, radius)

# 4. Create a vector in the z direction
vector = rg.Vector3d.ZAxis * distance

# 5. Move the point using the prevously created vector
newPoint = point + vector

# 6. Create a line between both points
line = rg.Line(point,newPoint)

# TIP
# Sweep requires to inputs as 'Nurbs Curves', so we must convert the line and the circle first
axis = line.ToNurbsCurve()
profile = circle.ToNurbsCurve()

# 8. Create the sweep brep.
brep = rg.Brep.CreateFromSweep(axis,profile,False,0.01)[0]

# 8.1. Optionally closed the planar holes in the extrusion.
closedBrep = rg.Brep.CapPlanarHoles(brep,0.01)

# 9. Assign brep to output
extrude = closedBrep
# ---------- end python_2 ----------

# ----
pi = Pi(Factor=Slider(0.07, range=0..1))
pt_4 = Point(Point(0.4390337337, 1.433439472, 0))
python_3 = GhPythonScript(point=pt, attractor=pt_4, maxRot=pi)  # -> out, shape, axis, sweep; inputs point: Point3d, attractor: Point3d
# ---------- python_3: Python ----------
import Rhino.Geometry as rg
import math
import random
distance = point.DistanceTo(attractor)

radius = .01 / distance
print(radius)

maxRadius = 0.045
minRadius = 0.02

# Lock the radius into a specific range
if(radius > maxRadius):
    radius = maxRadius

if(radius < minRadius):
    radius = minRadius
    
circle = rg.Circle(point,radius)

squarePlane = rg.Plane(point,rg.Vector3d.ZAxis)

ratio = (radius - minRadius) / (maxRadius - minRadius)
rot = ratio * maxRot

squarePlane.Rotate(rot,rg.Vector3d.ZAxis)

squareInterval = rg.Interval(-radius,radius)

square = rg.Rectangle3d(squarePlane,squareInterval,squareInterval)

shape = square
# ---------- end python_3 ----------

# ---- group: Bonus - Sticky Context
timer = Timer(Interval=-100, TimerInterval=100, Target=python_4)  # disabled
python_4 = GhPythonScript(x="0", y="0.01", reset=Button())  # -> out, a
# ---------- python_4: Python ----------
import scriptcontext


stickyval = 0
# restore stickyval if it has been saved
if scriptcontext.sticky.has_key("t-value"):
    stickyval = scriptcontext.sticky["t-value"]

if reset:
    a = 0
    scriptcontext.sticky["t-value"] = 0
else:
    a = stickyval
    # save the value for use in the future
    scriptcontext.sticky["t-value"] = (stickyval + y) % 1
# ---------- end python_4 ----------
panel_2 = Panel(python_4.a)
