# Grasshopper definition Day02-START.ghx (Grasshopper 1.0.7)
# Copyright: Alan Rynne

series = Series(Start=0, Step="0.1", Count=Slider(21, range=0..100))
pt = ConstructPoint(XCoordinate=graft(series), YCoordinate=series, ZCoordinate=0)  # -> simplify(Point)

# ---- group: Comparing things
python = GhPythonScript(number=Slider(4, range=0..10), compare=Slider(4, range=0..10))  # -> out
# ---------- python: Python ----------
import Rhino.Geometry as rg

# BOOLEAN VALUES, COMPARISONS AND CONDITIONALS

# Boolean values can be 'True' (notice capitalization)

# or 'False'

# You can make comparisons between values using '==' (two equal signs)

# A comparison will always return a boolean value.

# You can think of comparisons as YES or NO questions:
# - Is this value equals to 'True'?
# - Is this value bigger than 5?
# - Is this point's Z coordinate bigger than 7.0?

# Other comparisons are available

# 'number' and 'compare' are inputs coming from GH

# Equality check

# Inequality check

# Bigger than

# Bigger or equals than

# Smaller than

# Smaller or equals than


# You can also compare simple geometry entities (points, vectors...)

# Once you have a boolean value, you can 'negate' it by using the 'not()' function.
# ---------- end python ----------
panel = Panel(python)

# ----
range = Range(Domain=Domain(0, 1), Steps=Slider(10, range=0..10))
pt_2 = ConstructPoint(XCoordinate=graft(range), YCoordinate=range, ZCoordinate=0)
pt_3 = Point(Point(0.9634185682, 0.4892154751, 0.05846322429))
python_2 = GhPythonScript(point=pt_2, attractor=pt_3)  # -> out, circle, line, extrude; inputs point: Point3d, attractor: Point3d
# ---------- python_2: Python ----------
import Rhino.Geometry as rg

# We are going to create a simple 'attractor' exercise. 
# Given a point from a grid and an attractor point:

# 1. Get the distance between the point and the attractor
distance = point.DistanceTo(attractor)

# 2. Distance is usually too big to use as a radius, so divide by 10 (or whatever)

# 3. Create a circle using point and ratio
circle = rg.Circle(point, distance)

# 4. Create a vector in the z direction

# 5. Move the point using the prevously created vector

# 6. Create a line between both points

# TIP
# Sweep requires to inputs as 'Nurbs Curves', so we must convert the line and the circle first

# 8. Create the sweep brep.

# 8.1. Optionally closed the planar holes in the extrusion.

# 9. Assign brep to output
# ---------- end python_2 ----------

# ---- group: Inverse attractor
pi = Pi(Factor=Slider(0.07, range=0..1))
pt_4 = Point(Point(0.9319814938, 1.102701922, 0))
python_3 = GhPythonScript(point=pt, attractor=pt_4, maxRot=pi)  # -> out, shape, axis, sweep; inputs point: Point3d, attractor: Point3d
# ---------- python_3: Python ----------
import Rhino.Geometry as rg
import math
import random

# Get distance to point

# Modify distance to get a radius

# Set max and in radius

# Lock the radius into a specific range

# Create a plane for the square

# Compute the a number from 0 to 1 between the min and max radius

# Multiply ratio by max rotation to get current rotation

# Rotate plane

# Create an interval for the square

# Create the square

# Output
# ---------- end python_3 ----------
